# Dynamo graph PileFoundation.dyn (Dynamo 2.18.1.5096)
# packages: GenerativeDesign 6.0.2.0

# group: ABOUT
# This script is created for the conference NGM2024. The corresponding paper is names "On the benefits of visual programming in geotechnical planning practice"
# note: This script is used for demonstating the use of visual programming within geotechnical engineering. The chosen example is not a realistic / production ready tool. Instead, it aims at giving the user an impression, what can be achieved with little effort.
# Note:
# For creating the plot used in the report, the python library matplotlib is required. If you don't have it installed, please refer to https://github.com/DynamoDS/Dynamo/wiki/Customizing-Dynamo's-Python-3-installation.
# note: What is demonstrated:
# 1) Basic data flow within dynamo
# 2) Accessing geometry from another software (Revit)
# 3) Basic programming logic (conditionals, masks)
# 4) Geomery modelling
# 5) Integration of python scripting nodes in geometry and data workflows
# 6) Exporting geometry (here as .sat)
# 7) Automatic report generation

# group: Example 1: Create a pile geometry
# An example used in the paper "on the benefits of visual programming in geotechnical planning practice" showing the basic functionality of Dynamo.
number = DoubleInput(0)
byCoordinates = Point.ByCoordinates(x=number, y=number, z=number)
number_slider_pile_radius = DoubleSlider(0.5, range=0..100 step 0.1)
byCenterPointRadius = Circle.ByCenterPointRadius(centerPoint=byCoordinates, radius=number_slider_pile_radius)
number_slider_pile_length = DoubleSlider(-10, range=-20..0 step 0.1)
extrudeAsSolid = Curve.ExtrudeAsSolid(curve=byCenterPointRadius, distance=number_slider_pile_length)

# group: Get elements from Revit
# Get the outline of the foundation
select_model_elements = DSModelElementsSelection()  # 6 picked in the model
geometry = Element.Geometry(element=select_model_elements)
flatten = List.Flatten(list=geometry)

# group: INPUTS
# User inputs for contolling the parametric system
string_filepath_store_results = StringInput("C:/Users/Johannes Beck/Desktop/NGM/")
number_slider_distance_piles_to = DoubleSlider(-1, range=-1..100 step 0.1)  # "Number Slider - Distance piles to boarder"
number_slider_pile_spacing_x = DoubleSlider(3.9, range=1..10 step 0.1)
number_slider_pile_spacing_y = DoubleSlider(3.9, range=1..10 step 0.1)
number_slider_pile_radius_2 = DoubleSlider(0.5, range=0..100 step 0.1)
boolean_adjust_pile_length = BoolSelector(true)
number_slider_required_length_in = DoubleSlider(1, range=0..100 step 0.1)  # "Number Slider - Required Length in load bearing soil layer"
number_slider_pile_length_2 = DoubleSlider(22.1, range=0..100 step 0.1)
number_slider_thickness_of_slab = DoubleSlider(0.7, range=0.1..2 step 0.1)

# group: Stored Data
# Some curves from Revit.
remember = Data.Remember()  # unwired: arg0

# group: Compute pile positions
byJoinedCurves = PolyCurve.ByJoinedCurves(curves=remember)
offsetMany = Curve.OffsetMany(curve=byJoinedCurves, signedDistance=number_slider_distance_piles_to)
byGeometry = BoundingBox.ByGeometry(geom=offsetMany)
minPoint = BoundingBox.MinPoint(boundingBox=byGeometry)
maxPoint = BoundingBox.MaxPoint(boundingBox=byGeometry)
code_block = CodeBlock(pt_min=minPoint, x_step=number_slider_pile_spacing_x, pt_max=maxPoint, y_step=number_slider_pile_spacing_y)
# ---------- code_block.designscript (5 lines) ----------
x_range = pt_min.X-x_step..pt_max.X+x_step..x_step;
y_range = pt_min.Y-y_step..pt_max.Y+y_step..y_step;
z_val = pt_min.Z;

pt_mid = Point.ByCoordinates(0.5*(pt_min.X + pt_max.X), 0.5*(pt_min.Y + pt_max.Y), pt_min.Z);
# ----------------------------------------
byCoordinates_2 = Point.ByCoordinates(x=code_block.x_range, y=code_block.y_range, z=code_block.z_val, lacing=CrossProduct)
points = PolyCurve.Points(polyCurve=offsetMany)
byPoints = Polygon.ByPoints(points=points)
containmentTest = Polygon.ContainmentTest(polygon=byPoints, point=byCoordinates_2)
filterByBoolMask = List.FilterByBoolMask(list=byCoordinates_2, mask=containmentTest)
isEmpty = List.IsEmpty(list=filterByBoolMask.in@L2)
filterByBoolMask_2 = List.FilterByBoolMask(list=filterByBoolMask.in, mask=isEmpty)
byCenterPointRadius_2 = Circle.ByCenterPointRadius(centerPoint=filterByBoolMask_2.out, radius=number_slider_pile_radius_2)

# group: Create Soil Layer
byOriginNormal = Plane.ByOriginNormal(origin=code_block.pt_mid)
code_block_2 = CodeBlock { 1.5; }
scale = Geometry.Scale(geometry=byCoordinates_2, plane=byOriginNormal, xamount=code_block_2, yamount=code_block_2)
python_script_sin_function_for_z = Python(IN[0]=scale)  # "Python Script - sin function for z vals"; CPython3
# ---------- python_script_sin_function_for_z.python (24 lines) ----------
# Load the Python Standard and DesignScript Libraries
import sys
import clr
clr.AddReference('ProtoGeometry')
from Autodesk.DesignScript.Geometry import *

import math
# The inputs to this node will be stored as a list in the IN variables.
dataEnteringNode = IN

# Place your code below this line

# Assign your output to the OUT variable.

pts_new = []
for i in IN[0]:
    sublist = []
    for j in i:
        pt_new = Point.ByCoordinates(j.X, j.Y, -8 - math.sin(j.Y/30 + j.X/20) * 6)
        sublist.append(pt_new)
    pts_new.append(sublist)
        

OUT = pts_new
# ----------------------------------------
byControlPoints = NurbsSurface.ByControlPoints(controlVertices=python_script_sin_function_for_z)

# group: Optional adjustment of pile length
# Adjust pile length so that the minimal length in the load bearing layer is met
code_block_3 = CodeBlock()
# ---------- code_block_3.designscript (3 lines) ----------
0;
//A very large number ensuring an intersection
-1000;
# ----------------------------------------
byCoordinates_3 = Vector.ByCoordinates(x=code_block_3.out0, y=code_block_3.out0, z=code_block_3.out1)
add = Point.Add(point=filterByBoolMask_2.out, vectorToAdd=byCoordinates_3)
byStartPointEndPoint = Line.ByStartPointEndPoint(startPoint=filterByBoolMask_2.out, endPoint=add)
intersect = Geometry.Intersect(geometry=byStartPointEndPoint@@L2, other=byControlPoints)
code_block_4 = CodeBlock { 2; }
normalizeDepth = List.NormalizeDepth(list=intersect, rank=code_block_4)
code_block_5 = CodeBlock(x=number_slider_required_length_in) { 0; y = x*(-1); }
byCoordinates_4 = Vector.ByCoordinates(x=code_block_5.out0, y=code_block_5.out0, z=code_block_5.y)
add_2 = Point.Add(point=normalizeDepth, vectorToAdd=byCoordinates_4)
byTwoPoints = Vector.ByTwoPoints(start=filterByBoolMask_2.out, end=add_2)

# group: Create Piles
code_block_6 = CodeBlock(pile_len=number_slider_pile_length_2) { out=Vector.ByCoordinates(0,0,-pile_len); }
if_ = RefactoredIf(test=boolean_adjust_pile_length, true=byTwoPoints, false=code_block_6)
extrudeAsSolid_2 = Curve.ExtrudeAsSolid(curve=byCenterPointRadius_2, direction=if_)

# group: OUTPUT - REPORT AS HTML
# Create a report as HTML with a matplotlib-plot
create_a_report = Python(IN[0]=string_filepath_store_results, IN[1]=extrudeAsSolid_2, IN[2]=filterByBoolMask.in, IN[3]=byJoinedCurves)  # CPython3
# ---------- create_a_report.python (80 lines) ----------
import sys
import clr
clr.AddReference('ProtoGeometry')
from Autodesk.DesignScript.Geometry import *

import locale
locale.setlocale(locale.LC_ALL, 'en_US')


#import pandas as pd
import matplotlib.pyplot as plt

filepath = IN[0]
piles = IN[1]
pile_pts = IN[2]
slab_polycrv = IN[3]



# make slab pts closed
slab_pts = list(slab_polycrv.Points)
slab_pts.append(slab_pts[0])
slab_area = Polygon.ByPoints(slab_pts).Patch().Area

# create a simple plot
fig, axs = plt.subplots()
piles = [item for row in piles for item in row]
pile_pts = [item for row in pile_pts for item in row]
sc = plt.scatter(x = [i.X for i in pile_pts], y=[i.Y for i in pile_pts],c = [i.Volume for i in piles])
axs.axis('equal')
cbar = plt.colorbar()
cbar.set_label("Pile Volume [m³]")
plt.title("Pile layout")

plt.plot([i.X for i in slab_pts], [i.Y for i in slab_pts])

plt.savefig(filepath+"pile_volumes.png")

plt.cla()

# Note: There are libraries to write html and if you want to use this in production, use a templating system as Jinja2
with open(filepath+"report.html", "w") as f:
    f.write("<html>")
    f.write(
        """
        <head>
            <title>Geotechnical Report</title>
            <style>
            body {
                height: 842px;
                width: 595px;
                /* to centre page on screen*/
                margin-left: auto;
                margin-right: auto;
            }
            </style>
          </head>
        """
    )


    f.write(
        f"""
        <body>
            <h1>Report - Example NGM</h1>
            <h4>Created using Autodesk Dynamo</h4>
            <p align=“justify“>
                This report is created to demonstrate the use of visual progamming languages in geotechnical engineering. The chosen example is a pile foundation, which is created parametrically. This report is created from a python node within Autodesk Dynamo. The report is written in HTML. It is instantly updated, when inputs and therefore its content, are changed.
            </p>
            
            <img src="{'pile_volumes.png'}" alt="Pile Layout">
            
            <h4>About the design</h4>
            <p>
                The design consists of {len(piles)} piles. The total volume of the piles is {round(sum([i.Volume for i in piles]),2)} cubic meters. The slab on top of the piles has the area of {round(slab_area, 2)} square meters.
            </p>
        </body>
        </html>
        """
    )
# ----------------------------------------

# group: OUTPUT - PILES AS SAT-FILE
# Export only the pile geometrys as SAT
flatten_2 = List.Flatten(list=extrudeAsSolid_2)
code_block_7 = CodeBlock { ""; "piles.sat"; }
join = String.Join(separator=code_block_7.out0, string0=string_filepath_store_results, string1=code_block_7.out1)
exportToSAT = Geometry.ExportToSAT(geometry=flatten_2, filePath=join)

# group: Dynamo-Preview
code_block_8 = CodeBlock { 255; 0; 0; 255; }
byARGB = Color.ByARGB(alpha=code_block_8.out0, red=code_block_8.out1, green=code_block_8.out2, blue=code_block_8.out3)
byGeometryColor = Modifiers.GeometryColor.ByGeometryColor(geometry=byControlPoints, color=byARGB)

# group: Compute Slab
byPatch = Surface.ByPatch(closedCurve=byJoinedCurves)
boolean = BoolSelector(false)
thicken = Surface.Thicken(surface=byPatch, thickness=number_slider_thickness_of_slab, both_sides=boolean)

# group: Dynamo-Preview
code_block_9 = CodeBlock { 255; 130; 130; 0; }
byARGB_2 = Color.ByARGB(alpha=code_block_9.out0, red=code_block_9.out1, green=code_block_9.out2, blue=code_block_9.out3)
byGeometryColor_2 = Modifiers.GeometryColor.ByGeometryColor(geometry=thicken, color=byARGB_2)
